# Grasshopper definition Assignment3.gh (Grasshopper 1.0.7)

number = Number(5)
number_2 = Number(5)
polygon = Polygon(Plane=PlaneXY(0, 0, 0), Radius=number, Segments=number_2, FilletRadius=0)  # -> Polygon, Length
number_3 = Number(0)
number_4 = Number(0)
number_5 = Number(0)
vector_xyz = VectorXYZ(XComponent=number_5, YComponent=number_3, ZComponent=number_4)  # -> Vector, Length
move = Move(Geometry=polygon.Polygon, Motion=vector_xyz.Vector)  # -> Geometry, Transform
rotate = Rotate(Geometry=move.Geometry, Angle=1.570796327, Plane=PlaneXY(0, 0, 0))  # -> Geometry, Transform
number_6 = Number(12)
linear_array = LinearArray(Geometry=rotate.Geometry, Direction=Vector(10, 0, 0), Count=number_6)  # -> Geometry, Transform
