# Grasshopper definition assignment2.gh (Grasshopper 1.0.7)

number_slider = Slider(2.55, range=0..5)
number_slider_2 = Slider(10, range=0..30)
multiplication = Multiplication(A=number_slider, B=-0.5)
point = Point(Point(0.02627930521, -0.06569826303, 0))
number = Number(4)
vector_xyz = VectorXYZ(XComponent=multiplication, YComponent=number_slider_2, ZComponent=0)  # -> Vector, Length
rectangle = Rectangle(Plane=point, XSize=number_slider, YSize=number_slider_2, Radius=0)  # -> Rectangle, Length
circle = Circle(Plane=PlaneXY(0, 0, 0), Radius=Slider(15, range=0..20))
move = Move(Geometry=rectangle.Rectangle, Motion=vector_xyz.Vector)  # -> Geometry, Transform
polar_array = PolarArray(Geometry=move.Geometry, Plane=PlaneXY(0, 0, 0), Count=number, Angle=6.283185307)  # -> Geometry, Transform
region_difference = RegionDifference(CurvesA=circle, CurvesB=polar_array.Geometry)
